# Grasshopper definition SCRIPT-RobotsAdvanced-LightPainting.gh (Grasshopper 1.0.4)
# plug-ins: Robots

crv = Curve(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)
curve_to_polyline = CurveToPolyline(Curve=crv, ToleranceDistance="0.5", ToleranceAngle=0)  # -> Polyline, Segments
discontinuity = Discontinuity(Curve=curve_to_polyline.Polyline, Level=1)  # -> Points, Parameters
xy = XYPlane(Origin=discontinuity.Points)

# ----
# THE POINT OF THE ENDEFFECTOR MUST BE REPLACED WITH THE REAL VALUES READ FROM THE ROBOTIC PENDANT AFTER THE 4 POINT CALIBRATION WITH THE EXTRUDER
panel = Panel("11.0983")
# END EFFECTOR CONFIGURATION
pt = Point(Point(0, 0, 81.63996995))
pt_2 = ConstructPoint(XCoordinate=panel, YCoordinate="132.081", ZCoordinate="81.952")
Y = UnitY(Factor=1)
xy_2 = XYPlane(Origin=pt)
rot3d = Rotate3D(Geometry=xy_2, Angle=degrees(Slider(-180, range=-180..180)), Center=xy_2, Axis=Y)  # -> Geometry, Transform
brep = Brep(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)
tool = CreateTool(Name="tool1", TCP=rot3d.Geometry, Weight=0, Mesh=brep)  # -> Tool, TCP

# ----
# MOTION CONFIGURATION-SPEEDS-ZONE
Y_2 = UnitY(Factor=1)
rot3d_2 = Rotate3D(Geometry=xy, Angle=degrees(Slider(-90, range=-90..90)), Center=xy, Axis=Y_2)  # -> Geometry, Transform

# ----
# ADVANCED ROBOT PROGRAM
# ROBOT SELECTOR CONFIGURATION
list = ValueList({"AA-KR60", "AA-KR30", "AA-KR60_KR30", "AARCH IRB120", "AARCH IRB6620", "Bartlett-IRB120", "Bartlett-IRB1600", "Bartlett-KR6", "Bartlett-KR60", "Bartlett-UR10"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}, selected="iaac-IRB140")
load_robot = LoadRobotSystem(Name=list, Base=PlaneXY(0, 0, 0))

# ----
# INITIAL AND FINAL POSITION IN JOINTS ANGLES
number_slider = Slider(-60, range=-180..180)
merge = Merge(
    Data1=number_slider,
    Data2=Slider(-40, range=-180..180),
    Data3=Slider(40, range=-180..180),
    Data4=Slider(0, range=-180..180),
    Data5=Slider(0, range=-180..180),
    Data6=Slider(0, range=-180..180))
degrees_to_radians = DegreesToRadians(Degrees=merge, RobotSystem=load_robot, MechanicalGroup=0)
target = CreateTarget(Joints=degrees_to_radians, IsCartesian=False)

# ----
# SIMULATION AND PREVIEW
knob = ControlKnob(Decimals=3, Limit=True, Maximum=1, Minimum=0, Range=0.1, Value=0.443)

# ---- group: Plane
pln = Plane(flatten(rot3d_2.Geometry))
split_list = SplitList(List=pln, Index="1")  # -> ListA, ListB
list_2 = ValueList({"Joint", "Linear"}, selected="Joint")
list_3 = ValueList({"Joint", "Linear"}, selected="Linear")

# HERE IS WHERE YOU SHOULD CONNECT ALL YOU PLANES AND CREATE TARGETS
# (FIRST IS BETTER TO BE A JOINT)
speed_mms_s = Slider(30, range=0..100)
airtravellingspeed = Slider(100, range=0..100)
zone_mm = Slider(0.5, range=0..50)
plane = Plane(split_list.ListA)
target_2 = CreateTarget(Plane=plane, Motion=list_2, Tool=tool.Tool, Speed=airtravellingspeed, IsCartesian=True)

target_3 = CreateTarget(Plane=split_list.ListB, Motion=list_3, Tool=tool.Tool, Speed=speed_mms_s, Zone=zone_mm, IsCartesian=True)

# ----
merge_2 = Merge(Data1=flatten(target), Data2=flatten(target_2), Data3=flatten(target_3), Data4=flatten(target))
# ASSEMBLER
program = CreateProgram(Name="MyWonderfullRobotCode", RobotSystem=load_robot, Targets1=merge_2, StepSize=1)  # -> Program, Code, Duration, Warnings, Errors
# OUTPUT CODE
panel_2 = Panel(program.Code)
# NO ERRORS SHOULD BE FOUND
panel_3 = Panel(program.Errors)

# ----
# MOVE THE SLIDE TO SIMULATE
number_slider_2 = Slider(0, range=0..1)
sim = ProgramSimulation(Program=program.Program, Time=knob, Normalized=True)  # -> SystemMeshes, JointRotations, Plane, Index, Time, Program, Errors
