# Grasshopper definition SCRIPT-RobotsFull.gh (Grasshopper 1.0.7)
# plug-ins: Robots, Pufferfish, Bifocals

panel = Panel("174.57,-115.71,11.99")
panel_2 = Panel("581.48, 201.16, 14.12")
panel_3 = Panel("581.3, -115.73, 13.43")
md_slider = MDSlider(
    SliderMode=0,
    slider_value=Point(0.5774446813, 0.4479652963, 0.5),
    x_domain=Domain(0, 1),
    y_domain=Domain(0, 1),
    z_domain=Domain(0, 1))

number_slider = Slider(150, range=-1000..1000)
number_slider_2 = Slider(-250, range=-1000..1000)
number_slider_3 = Slider(650, range=-1000..1000)
number_slider_4 = Slider(13.4, range=-1000..1000)
number_slider_5 = Slider(250, range=-1000..1000)
# BED LEVELING/POSITION SETUP
construct_point = ConstructPoint(XCoordinate=number_slider_3, YCoordinate=number_slider_2, ZCoordinate=number_slider_4)
construct_point_2 = ConstructPoint(XCoordinate=number_slider, YCoordinate=number_slider_2, ZCoordinate=Slider(12, range=-1000..1000))
construct_point_3 = ConstructPoint(XCoordinate=number_slider, YCoordinate=number_slider_5, ZCoordinate=Slider(14.1, range=-1000..1000))
construct_point_4 = ConstructPoint(XCoordinate=number_slider_3, YCoordinate=number_slider_5, ZCoordinate=Slider(12, range=-1000..1000))
_4point_surface = _4PointSurface(CornerA=construct_point, CornerB=construct_point_2, CornerC=construct_point_3, CornerD=construct_point_4)
evaluate_surface = EvaluateSurface(Surface=reparameterize(_4point_surface), Point=md_slider)  # -> Point, Normal, UDirection, VDirection, Frame

unit_z = UnitZ(Factor=number_slider_4)
negative = Negative(Value=unit_z)
extrude = Extrude(Base=_4point_surface, Direction=negative)
custom_preview = CustomPreview(Geometry=extrude, Material=ColourSwatch(SwatchColor=RGB(120, 99, 53)))
curve = Curve(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)
curve_to_polyline = CurveToPolyline(Curve=curve, ToleranceDistance="0.5", ToleranceAngle=0)  # -> Polyline, Segments
discontinuity = Discontinuity(Curve=curve_to_polyline.Polyline, Level=1)  # -> Points, Parameters
list_item = ListItem(List=discontinuity.Points, Index=0, Wrap=True)
vector_2pt = Vector2Pt(PointA=list_item, PointB=evaluate_surface.Point, Unitize=False)  # -> Vector, Length
move = Move(Geometry=discontinuity.Points, Motion=vector_2pt.Vector)  # -> Geometry, Transform
xy = XYPlane(Origin=move.Geometry)
# HERE IS WHERE YOU SHOULD CONNECT ALL YOU PLANES AND CREATE TARGETS
# (FIRST IS BETTER TO BE A JOINT)
rotate = Rotate(Geometry=xy, Angle=degrees(Slider(90, range=0..360)), Plane=xy)  # -> Geometry, Transform
pln = Plane(flatten(rotate.Geometry))
split_list = SplitList(List=pln, Index="1")  # -> ListA, ListB
speed_mms_s = Slider(30, range=0..100)
airtravellingspeed = Slider(100, range=0..100)
zone_mm = Slider(0.5, range=0..50)
list_item_2 = ListItem(List=split_list.ListB, Index="-1", Wrap=True)

# ----
# FULL ROBOT PROGRAM
# ROBOT SELECTOR CONFIGURATION
list = ValueList({"AA-KR60", "AA-KR30", "AA-KR60_KR30", "AARCH IRB120", "AARCH IRB6620", "Bartlett-IRB120", "Bartlett-IRB1600", "Bartlett-KR6", "Bartlett-KR60", "Bartlett-UR10"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}, selected="Bartlett-IRB120")
load_robot = LoadRobotSystem(Name=list, Base=PlaneXY(0, 0, 0))

pt = Point(Point(356.9695618, 0, 43.20747885))
# SAMPLE EXTRUDER
mesh = Mesh(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)

unit_x = UnitX(Factor=1)

model_extrudersimple45degrees = Mesh(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)
point = Point(Point(105.8809433, -21, 176.017868))

model_extrudersimple90degrees = Mesh(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)
point_2 = Point(Point(181.7314735, -22.26134535, 128.5892481))

# ----
# EXTRUDER
# COLLECTION
trifilamentextruder = Mesh(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)
point_3 = Point(Point(254.0884622, -1.585675968, 99.99460355))

pelletextruder = Mesh(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)
point_4 = Point(Point(379.6715652, -2.182387626, 43.43000232))

# ----
# MOVE THE SLIDE TO SIMULATE
number_slider_6 = Slider(0, range=0..1)
# SIMULATION AND PREVIEW
knob = ControlKnob(Decimals=3, Limit=True, Maximum=1, Minimum=0, Range=0.1, Value=0)
data = Data(number_slider_6)

# ---- group: ROBOT TABLE
mesh_2 = Mesh(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)
custom_preview_2 = CustomPreview(Geometry=mesh_2, Material=ColourSwatch(SwatchColor=RGB(97, 97, 97)))

# ----
# Tool Definition
panel_4 = Panel("9.769091")
# UNITS ROBOTS: Length: Millimeters
#     Angle: Radians
#     Weight: Kilograms
#     Time: Seconds
#     Linear speed: Millimeters per second
#     Angular speed: Radians per second
# THE POINT OF THE ENDEFFECTOR MUST BE REPLACED WITH THE REAL VALUES READ FROM THE ROBOTIC PENDANT AFTER THE 4 POINT CALIBRATION WITH THE EXTRUDER
panel_5 = Panel("188.5896")
construct_point_5 = ConstructPoint(XCoordinate=panel_5, YCoordinate=panel_4, ZCoordinate="54.54")
real_tcp = BooleanToggle(False)
pt_2 = Point(point)
stream_filter = StreamFilter(Gate=real_tcp, Stream0=pt_2, Stream1=construct_point_5)
Y = UnitY(Factor=1)
xy_2 = XYPlane(Origin=stream_filter)
rot3d = Rotate3D(Geometry=xy_2, Angle=degrees(Slider(45, range=-90..90)), Center=xy_2, Axis=Y)  # -> Geometry, Transform
flip_plane = FlipPlane(Plane=rot3d.Geometry, FlipX=False, FlipY=False, FlipZ=True)  # -> Flipped, ResultBoolean
name_of_your_tool = Panel("SIMPLETOOL")
mesh_3 = Mesh(model_extrudersimple45degrees)
kg = Panel("0.5")

rot3d_2 = Rotate3D(Geometry=flip_plane.Flipped, Angle=degrees(Slider(0, range=-90..90)), Center=rot3d.Geometry, Axis=unit_x)  # -> Geometry, Transform

create_tool = CreateTool(Name=name_of_your_tool, TCP=rot3d_2.Geometry, Weight=kg, Mesh=mesh_3)  # -> Tool, TCP

# ----
# INITIAL AND FINAL POSITION IN JOINTS ANGLES
number_slider_7 = Slider(-60, range=-180..180)
merge = Merge(
    Data1=number_slider_7,
    Data2=Slider(-40, range=-180..180),
    Data3=Slider(40, range=-180..180),
    Data4=Slider(0, range=-180..180),
    Data5=Slider(0, range=-180..180),
    Data6=Slider(0, range=-180..180))
degrees_to_radians = DegreesToRadians(Degrees=merge, RobotSystem=load_robot, MechanicalGroup=0)
speed = Panel("50")
target = CreateTarget(Joints=degrees_to_radians, Tool=create_tool.Tool, Speed=speed, IsCartesian=False)

# ----
# MOTION CONFIGURATION-SPEEDS-ZONE
first_plane = Geometry(split_list.ListA)
digital_pin_connected_to_octocoupler = Panel("0")
zone_mm_2 = Slider(0, range=0..50)
list_length = ListLength(List=first_plane)
list_2 = ValueList({"Joint", "Linear"}, selected="Joint")
set_do = SetDO(DO=digital_pin_connected_to_octocoupler, Value=Toggle(True))
repeat_data = RepeatData(Data=list_2, Length=list_length)
plane = Plane(first_plane)
target_2 = CreateTarget(
    Plane=plane,
    Motion=repeat_data,
    Tool=create_tool.Tool,
    Speed=airtravellingspeed,
    Zone=zone_mm_2,
    Command=set_do,
    IsCartesian=True)

rest_of_planes = Geometry(split_list.ListB)
list_length_2 = ListLength(List=rest_of_planes)
list_3 = ValueList({"Joint", "Linear"}, selected="Linear")
repeat_data_2 = RepeatData(Data=list_3, Length=list_length_2)
target_3 = CreateTarget(Plane=rest_of_planes, Motion=repeat_data_2, Tool=create_tool.Tool, Speed=speed_mms_s, Zone=zone_mm, IsCartesian=True)

last_plane = Geometry(list_item_2)
digital_pin_connected_to_octocoupler_2 = Panel("0")
zone_mm_3 = Slider(0, range=0..50)
# END EFFECTOR CONFIGURATION
boolean_toggle = BooleanToggle(False)
list_length_3 = ListLength(List=last_plane)
list_4 = ValueList({"Joint", "Linear"}, selected="Linear")
set_do_2 = SetDO(DO=digital_pin_connected_to_octocoupler_2, Value=boolean_toggle)
repeat_data_3 = RepeatData(Data=list_4, Length=list_length_3)
target_4 = CreateTarget(
    Plane=last_plane,
    Motion=repeat_data_3,
    Tool=create_tool.Tool,
    Speed=speed_mms_s,
    Zone=zone_mm_3,
    Command=set_do_2,
    IsCartesian=True)

# ----
# Commands are added at the first and last targets of
# each contour to turn the extruder on and off.
# Aproximation zone is set to 0 to sync the commands
# with the position of the robot.
# The speed to the first target is changed to the
# approach speed.
panel_6 = Panel(target_2)
merge_2 = Merge(Data1=flatten(target), Data2=flatten(target_2), Data3=flatten(target_3), Data4=flatten(target_4), Data5=flatten(target))
# ASSEMBLER
program = CreateProgram(Name="MyWonderfullRobotCode", RobotSystem=load_robot, Targets1=merge_2, StepSize=1)  # -> Program, Code, Duration, Warnings, Errors
# OUTPUT CODE
panel_7 = Panel(program.Code)
# NO ERRORS SHOULD BE FOUND
panel_8 = Panel(program.Errors)
# PROGRAM TIME
division = Division(A=program.Duration, B="60")
minutes = Panel(division)

program_simulation = ProgramSimulation(Program=program.Program, Time=data, Normalized=True)  # -> SystemMeshes, JointRotations, Plane, Index, Time, Program, Errors

deconstruct_program_targets = DeconstructProgramTargets(Program=program_simulation.Program)  # -> Planes, Joints, Configuration, DeltaTime
list_length_4 = ListLength(List=deconstruct_program_targets.Joints)
addition = Addition(A=list_length_4, B="1")
list_item_3 = ListItem(List=deconstruct_program_targets.Planes, Index=Slider(7, range=0..10), Wrap=True)
polyline = PolyLine(Vertices=flatten(list_item_3), Closed=False)
custom_preview_3 = CustomPreview(ALLMOTIONSDISPLAY=polyline, Material=ColourSwatch(SwatchColor=RGB(0, 149, 255)))

flip_matrix = FlipMatrix(Data=deconstruct_program_targets.Joints)
# SIMULATION AND PREVIEW
axis_rotation = QuickGraph(flip_matrix, SortOrder=0)

# ---- group: Display Data
split_list_2 = SplitList(List=program_simulation.SystemMeshes, Index="7")  # -> ListA, ListB
simple_trail = SimpleTrail(Program=program_simulation.Program, Length="200000", MechanicalGroup=0)
custom_preview_4 = CustomPreview(ROBOTDISPLAY=split_list_2.ListA, Shader=ColourSwatch(SwatchColor=RGB(184, 184, 184)))
custom_preview_5 = CustomPreview(ENDEFFECTORDISPLAY=split_list_2.ListB, Shader=ColourSwatch(SwatchColor=RGB(131, 194, 252)))
custom_preview_6 = CustomPreview(PATHDISPLAY=simple_trail, Material=ColourSwatch(SwatchColor=RGB(0, 255, 136)))
